% Simulink data dictionary RBCM_Model.sldd
% references S32K3_Adc_Typedefs.sldd
% references S32K3_Dio_Typedefs.sldd

Std_ReturnType = Simulink.AliasType(BaseType="uint8", DataScope="Imported", HeaderFile="stdint.h")

Adc_CtuFifoResultType = Simulink.Bus(DataScope="Imported", HeaderFile="Adc_Ipw_Types.h")
  TriggerIdx: uint8
  ChanIdx: uint8
  AdcNum: uint8
  AdcData: uint16

Adc_CtuResultType = Simulink.Bus(DataScope="Imported", HeaderFile="Bctu_Ip_Types.h")
  TriggerIdx: uint8
  ChanIdx: uint8
  AdcData: uint16
  ListFlag: boolean
  LastFlag: boolean

Adc_CalibrationStatusType = Simulink.Bus(DataScope="Imported", HeaderFile="Adc_Ipw_Types.h")
  AdcUnitSelfTestStatus: Std_ReturnType

Bus_CAN_RX_MESSAG = Simulink.Bus()
  Extended: uint8
  Length: uint32
  Remote: uint8
  Error: uint8
  ID: uint32
  Timestamp: double
  Data: uint8[8]

Bus_Hsd_Diagnose_Results = Simulink.Bus()
  DevicePwr_12v_lHsd1ch1: uint8
  BspdPwr_lHsd1ch2: uint8
  LoggerPwr_lHsd1ch3: uint8
  TempSensorPwr_lHsd1ch4: uint8
  DevicePwr_12v_lHsd2ch1: uint8
  VcuPwr_lHsd2ch2: uint8
  Fireon_Pwr_lHsd2ch3: uint8
  DsbdPwr_lHsd2ch4: uint8
  DrsPwr_8v_lHsd3ch1: uint8
  DevicePwr_lHsd3ch2: uint8
  BuzzerPwr_lHsd3ch3: uint8
  TaillightPwr_lHsd3ch4: uint8
  DevicePwr_5v_lHsd4ch1: uint8
  AccuUbr_lHsd4ch2: uint8
  AccuPwr_lHsd4ch3: uint8
  BduPwr_lHsd4ch4: uint8
  DevicePwr_5v_lHsd5ch1: uint8
  McuUbr_lHsd5ch2: uint8
  EnergeMeterPwr_lHsd5ch3: uint8
  TsalrPwr_lHsd5ch4: uint8
  ILPwr_hHsd1ch1: uint8
  DevicePwr_hHsd1ch2: uint8
  VcuUbr_hHsd2ch1: uint8
  Device_hHsd2ch2: uint8
  PumpPwr_hHsd3ch1: uint8
  AccuFanPwr_hHsd3ch2: uint8
  PumpFan1_hHsd4ch1: uint8
  PumpFan2_hHsd4ch2: uint8
  DevicePwr_hHsd5ch1: uint8
  DevicePwr_hHsd5ch2: uint8
  DevicePwr_hHsd6ch1: uint8
  DevicePwr_hHsd6ch2: uint8

Bus_Vehicle_Data = Simulink.Bus()
  ActButtonState: uint8
  ReadyButtonState: uint8
  McuReadyState: uint8
  DriveReadyState: uint8
  AccuV: uint16
  AccuI: uint16
  AccuTcmax: uint16
  AccudVmax: uint16
  McuT: uint16
  MotorRpm: uint16
  MotorTorque: uint16
  MotorTemp: uint16

Bus_Vbats_Data = Simulink.Bus()
  LvBatsV: uint16
  LvBatsI: uint16
  LvBatTemp1: uint16
  LvBatTemp2: uint16

Bus_Hsd_Diagnose_Values = Simulink.Bus()
  DevicePwr_12v_lHsd1ch1: uint16
  BspdPwr_lHsd1ch2: uint16
  LoggerPwr_lHsd1ch3: uint16
  TempSensorPwr_lHsd1ch4: uint16
  DevicePwr_12v_lHsd2ch1: uint16
  VcuPwr_lHsd2ch2: uint16
  Fireon_Pwr_lHsd2ch3: uint16
  DsbdPwr_lHsd2ch4: uint16
  DrsPwr_8v_lHsd3ch1: uint16
  DevicePwr_lHsd3ch2: uint16
  BuzzerPwr_lHsd3ch3: uint16
  TaillightPwr_lHsd3ch4: uint16
  DevicePwr_5v_lHsd4ch1: uint16
  AccuUbr_lHsd4ch2: uint16
  AccuPwr_lHsd4ch3: uint16
  BduPwr_lHsd4ch4: uint16
  DevicePwr_5v_lHsd5ch1: uint16
  McuUbr_lHsd5ch2: uint16
  EnergeMeterPwr_lHsd5ch3: uint16
  TsalrPwr_lHsd5ch4: uint16
  ILPwr_hHsd1ch1: uint16
  DevicePwr_hHsd1ch2: uint16
  VcuUbr_hHsd2ch1: uint16
  Device_hHsd2ch2: uint16
  PumpPwr_hHsd3ch1: uint16
  AccuFanPwr_hHsd3ch2: uint16
  PumpFan1_hHsd4ch1: uint16
  PumpFan2_hHsd4ch2: uint16
  DevicePwr_hHsd5ch1: uint16
  DevicePwr_hHsd5ch2: uint16
  DevicePwr_hHsd6ch1: uint16
  DevicePwr_hHsd6ch2: uint16

Bus_Hsd_Drive_Commands = Simulink.Bus()
  DevicePwr_12v_lHsd1ch1: uint8
  BspdPwr_lHsd1ch2: uint8
  LoggerPwr_lHsd1ch3: uint8
  TempSensorPwr_lHsd1ch4: uint8
  DevicePwr_12v_lHsd2ch1: uint8
  VcuPwr_lHsd2ch2: uint8
  Fireon_Pwr_lHsd2ch3: uint8
  DsbdPwr_lHsd2ch4: uint8
  DrsPwr_8v_lHsd3ch1: uint8
  DevicePwr_lHsd3ch2: uint8
  BuzzerPwr_lHsd3ch3: uint8
  TaillightPwr_lHsd3ch4: uint8
  DevicePwr_5v_lHsd4ch1: uint8
  AccuUbr_lHsd4ch2: uint8
  AccuPwr_lHsd4ch3: uint8
  BduPwr_lHsd4ch4: uint8
  DevicePwr_5v_lHsd5ch1: uint8
  McuUbr_lHsd5ch2: uint8
  EnergeMeterPwr_lHsd5ch3: uint8
  TsalrPwr_lHsd5ch4: uint8
  ILPwr_hHsd1ch1: uint8
  DevicePwr_hHsd1ch2: uint8
  VcuUbr_hHsd2ch1: uint8
  Device_hHsd2ch2: uint8
  PumpPwr_hHsd3ch1: uint8
  AccuFanPwr_hHsd3ch2: uint8
  PumpFan1_hHsd4ch1: uint8
  PumpFan2_hHsd4ch2: uint8
  DevicePwr_hHsd5ch1: uint8
  DevicePwr_hHsd5ch2: uint8
  DevicePwr_hHsd6ch1: uint8
  DevicePwr_hHsd6ch2: uint8

CAN_MESSAGE_BUS = Simulink.Bus()
  Extended: uint8
  Length: uint8
  Remote: uint8
  Error: uint8
  ID: uint32
  Timestamp: double
  Data: uint8[8]